# Grasshopper definition Env Analysis.gh (Grasshopper 1.0.7)

# ---- group: Duration inputs
month = Slider(4, range=1..12)
month_2 = Slider(6, range=1..12)
hour = Slider(17, range=1..24)
day = Slider(1, range=1..31)
hour_2 = Slider(12, range=1..24)
day_2 = Slider(1, range=1..31)

# ----
to_month = GetNumber(month_2, AtLeast=1, AtMost=2147483647, Maximum=1.797693135e+308, Minimum=-1.797693135e+308)
from_hour = GetNumber(hour_2, AtLeast=1, AtMost=2147483647, Maximum=1.797693135e+308, Minimum=-1.797693135e+308)
from_month = GetNumber(month, AtLeast=1, AtMost=2147483647, Maximum=1.797693135e+308, Minimum=-1.797693135e+308)
to_hour = GetNumber(hour, AtLeast=1, AtMost=2147483647, Maximum=1.797693135e+308, Minimum=-1.797693135e+308)
from_day = GetNumber(day, AtLeast=1, AtMost=2147483647, Maximum=1.797693135e+308, Minimum=-1.797693135e+308)
to_day = GetNumber(day_2, AtLeast=1, AtMost=2147483647, Maximum=1.797693135e+308, Minimum=-1.797693135e+308)
ladybug = Ladybug_Ladybug()  # -> out; plug-in component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

# ---- group: Main Inputs
target_surface = Brep(<brep referenced from the Rhino model>)
surroundings = Brep([<brep referenced from the Rhino model> x9])

# ----
analysisperiod = Ladybug_AnalysisPeriod(fromMonth=from_month, fromDay=from_day, fromHour=from_hour, toMonth=to_month, toDay=to_day, toHour=to_hour)  # -> out, analysisPeriod; plug-in component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
building_skin = GetGeometry(target_surface, AtLeast=1, AtMost=2147483647, Filter=1074004029)
surroundings_2 = GetGeometry(surroundings, AtLeast=1, AtMost=2147483647, Filter=1074004029)

panel = Panel("http://climate.onebuilding.org/WMO_Region_4_North_and_Central_America/USA_United_States_of_America/IL_Illinois/USA_IL_Chicago.Midway.Intl.AP.725340_TMY3.zip")

weatherfile_url = GetString(panel, AtLeast=1, AtMost=2147483647)

epw_stat = Ladybug_OpenEPWAndSTATWeatherFiles(weatherFileURL=weatherfile_url)  # -> epwFile, statFile; plug-in component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
panel_2 = Panel(epw_stat.epwFile)

gencumulativeskymtx = Ladybug_GenCumulativeSkyMtx(epwFile=panel_2, skyDensity=Slider(0, range=0..100), useOldRes=True, runIt=Toggle(True))  # -> out, cumulativeSkyMtx; plug-in component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
selectskymtx = Ladybug_selectSkyMtx(
    cumulativeSkyMtx=gencumulativeskymtx.cumulativeSkyMtx,
    analysisPeriod=analysisperiod.analysisPeriod,
    removeDiffuse=False,
    removeDirect=False)  # -> out, selectedSkyMtx; plug-in component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
radiationanalysis = Ladybug_RadiationAnalysis(
    geometry=flatten(building_skin),
    context=flatten(surroundings_2),
    gridSize=Slider(13, range=0..100),
    disFromBase=Slider(0.1, range=0..0.1),
    selectedSkyMtx=flatten(selectskymtx.selectedSkyMtx),
    runIt=Toggle(True))  # -> out, contextMesh, analysisMesh, testPts, testVec, port, radiationResult, radiationMesh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; plug-in component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
panel_3 = Panel(radiationanalysis.radiationResult)

# ---- group: RH_OUT: RadiationLegend
rh_out_radiation_legend = Mesh(radiationanalysis.radiationLegend)

# ---- group: RH_OUT: RadiationMesh
mesh = Mesh(radiationanalysis.radiationMesh)
