# Grasshopper definition LB.gh (Grasshopper 1.0.7)
# plug-ins: Bifocals

# ---- group: USER PARAMETERS
triangle_radius = Slider(8.377, range=0..20)
length = Slider(13.807, range=0..20)
width = Slider(15.685, range=0..20)
pentagon_radius = Slider(12.71, range=0..20)
circle_radius = Slider(11.568, range=0..20)

floor_to_floor_height = Slider(4, range=2.8..4)
number_of_floors = Slider(9, range=0..20)

# ----
get_string = GetString(AtLeast=1, AtMost=2147483647)
get_number = GetNumber(circle_radius, AtLeast=1, AtMost=2147483647, Maximum=1.797693135e+308, Minimum=-1.797693135e+308)
get_number_2 = GetNumber(width, AtLeast=1, AtMost=2147483647, Maximum=1.797693135e+308, Minimum=-1.797693135e+308)
panel = Panel("C:\Users\richa\Desktop\HMC\Honeybee.face")
get_number_3 = GetNumber(pentagon_radius, AtLeast=1, AtMost=2147483647, Maximum=1.797693135e+308, Minimum=-1.797693135e+308)
get_number_4 = GetNumber(length, AtLeast=1, AtMost=2147483647, Maximum=1.797693135e+308, Minimum=-1.797693135e+308)
get_number_5 = GetNumber(floor_to_floor_height, AtLeast=1, AtMost=2147483647, Maximum=1.797693135e+308, Minimum=-1.797693135e+308)
get_number_6 = GetNumber(number_of_floors, AtLeast=1, AtMost=2147483647, Maximum=1.797693135e+308, Minimum=-1.797693135e+308)
websocket_client_start = WebsocketClientStart(Address="wss://hmc-hackathon-server.glitch.me/", InitalMessage="Hello World", Reset=Toggle(False))
ladybug = Ladybug_Ladybug(defaultFolder=panel)  # -> out; plug-in component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
honeybee = Honeybee_Honeybee(defaultFolder=panel)  # -> out; plug-in component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
websocket_client_receiver = WebsocketClientReceiver(WebsocketObjects=websocket_client_start, AutoUpdate=True)  # -> Message, Status
polygon = Polygon(Plane=PlaneXY(0, 0, 0), Radius=triangle_radius, Segments=3, FilletRadius=0)  # -> Polygon, Length
rectangle = Rectangle(Plane=PlaneXY(0, 0, 0), XSize=get_number_4, YSize=get_number_2, Radius=0)  # -> Rectangle, Length
polygon_2 = Polygon(Plane=PlaneXY(0, 0, 0), Radius=get_number_3, Segments=5, FilletRadius=0)  # -> Polygon, Length
circle = Circle(Plane=PlaneXY(0, 0, 0), Radius=get_number)
c_script = CSharpScript(
    Triangle=polygon.Polygon,
    Rectangle=rectangle.Rectangle,
    Pentagon=polygon_2.Polygon,
    Circle=circle,
    Classification=websocket_client_receiver.Message)  # -> out, A; inputs Triangle: Curve, Rectangle: Curve, Pentagon: Curve, Circle: Curve, Classification: String
# ---------- c_script: C# ----------
    if(Classification == "TRIANGLE"){
      A = Triangle;}
    if(Classification == "SQUARE AND RECTANGLE"){
      A = Rectangle;}
    if(Classification == "PENTAGON"){
      A = Pentagon;}
    if(Classification == "CIRCLE"){
      A = Circle;}
# ---------- end c_script ----------
panel_2 = Panel(websocket_client_receiver.Message)
boundary_surfaces = BoundarySurfaces(Edges=c_script.A)
unit_z = UnitZ(Factor=get_number_5)
series = Series(Start=0, Step=get_number_5, Count=get_number_6)
extrude = Extrude(Base=boundary_surfaces, Direction=unit_z)
unit_z_2 = UnitZ(Factor=series)
move = Move(Geometry=extrude, Motion=unit_z_2)  # -> Geometry, Transform
panel_3 = Panel("""false
true
false
false
false
false
false
false""")
number_slider = Slider(0.5, range=0..1)

# ---- group: USER PARAMETERS
opening_ht_from_ceiling = Slider(0.665, range=0..1)
opening_ht_from_floor = Slider(0.342, range=0..1)
open_width_from_corner_1 = Slider(0.766, range=0..1)
open_width_from_corner_2 = Slider(0.2, range=0..1)

# ----
deconstruct_brep = DeconstructBrep(Brep=move.Geometry)  # -> Faces, Edges, Vertices
cull_pattern = CullPattern(List=deconstruct_brep.Faces, CullPattern=panel_3)
divide_domain² = DivideDomain²(Domain=cull_pattern, UCount=number_slider, VCount=number_slider)
construct_domain² = ConstructDomain²(UMin=opening_ht_from_ceiling, UMax=opening_ht_from_floor, VMin=open_width_from_corner_1, VMax=open_width_from_corner_2)
isotrim = Isotrim(Surface=reparameterize(cull_pattern), Domain=divide_domain²)
deconstruct_brep_2 = DeconstructBrep(Brep=move.Geometry)  # -> Faces, Edges, Vertices
boundary_surfaces_2 = BoundarySurfaces(Edges=deconstruct_brep_2.Edges)
isotrim_2 = Isotrim(Surface=reparameterize(isotrim), Domain=construct_domain²)
brep = Brep(boundary_surfaces_2)
srf = Surface(brep)
createhbsrfs = Honeybee_createHBSrfs(geometry=srf)  # -> out, simplify(HBSurface); plug-in component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
area = Area(Geometry=isotrim_2)  # -> Area, Centroid
evaluate_surface = EvaluateSurface(Surface=isotrim_2, Point=area.Centroid)  # -> Point, Normal, UDirection, VDirection, Frame

dom = ConstructDomain(DomainStart=0, DomainEnd=Slider(0.3, range=0..0.5))

extrude_2 = Extrude(Base=isotrim_2, Direction=evaluate_surface.Normal)
multiplication = Multiplication(A=evaluate_surface.Normal, B=Slider(-1, range=-10..10))
move_2 = Move(Geometry=extrude_2, Motion=multiplication)  # -> simplify(flatten(Geometry)), Transform
gradientlibrary = Ladybug_GradientLibrary(gradIndex=Slider(2, range=0..5))  # -> customColors; plug-in component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
brep_2 = Brep(move_2.Geometry)
brep_3 = Brep(flatten(move.Geometry))
legendpar = Ladybug_LegendParameters(
    lowBound=Slider(0, range=0..10),
    highBound=Slider(100, range=0..100),
    numSegments=Slider(10, range=0..10),
    customColors=flatten(gradientlibrary),
    removeLessThan=Toggle(True))  # -> legendPar; plug-in component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
trim_solid = TrimSolid(Shape=brep_3, Cutters=brep_2)

# ---- group: BREPS READY FOR ENV ANALYSIS
openings_brep = Brep(isotrim_2)
whole_building_brep = Brep(trim_solid)

# ----
srf_2 = Surface(openings_brep)
brep_4 = Brep(whole_building_brep)
mass2zone = Honeybee_Masses2Zones(zoneMasses=flatten(brep_4), maxRoofAngle=30, createHBZones=Toggle(True))  # -> readMe, HBZones; plug-in component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
addhbglz = Honeybee_addHBGlz(HBObj=mass2zone.HBZones, childSurfaces=flatten(srf_2))  # -> HBObjWGLZ; plug-in component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

brep_5 = Brep(addhbglz)

panel_4 = Panel("http://climate.onebuilding.org/WMO_Region_4_North_and_Central_America/USA_United_States_of_America/IL_Illinois/USA_IL_Chicago.Midway.Intl.AP.725340_TMY3.zip")
epw_stat = Ladybug_OpenEPWAndSTATWeatherFiles(weatherFileURL=panel_4)  # -> epwFile, statFile; plug-in component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
panel_5 = Panel(epw_stat.epwFile)

# ---- group: Duration inputs
month = Slider(4, range=1..12)
month_2 = Slider(6, range=1..12)
hour = Slider(17, range=1..24)
day = Slider(1, range=1..31)
hour_2 = Slider(12, range=1..24)
day_2 = Slider(1, range=1..31)

# ---- group: Main Inputs
target_surface = Brep(<brep referenced from the Rhino model>)
surroundings = Brep([<brep referenced from the Rhino model> x9])

# ----
ladybug_2 = Ladybug_Ladybug()  # -> out; plug-in component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
get_number_7 = GetNumber(day, AtLeast=1, AtMost=2147483647, Maximum=1.797693135e+308, Minimum=-1.797693135e+308)
get_number_8 = GetNumber(hour_2, AtLeast=1, AtMost=2147483647, Maximum=1.797693135e+308, Minimum=-1.797693135e+308)
get_number_9 = GetNumber(month, AtLeast=1, AtMost=2147483647, Maximum=1.797693135e+308, Minimum=-1.797693135e+308)
get_number_10 = GetNumber(month_2, AtLeast=1, AtMost=2147483647, Maximum=1.797693135e+308, Minimum=-1.797693135e+308)
get_number_11 = GetNumber(day_2, AtLeast=1, AtMost=2147483647, Maximum=1.797693135e+308, Minimum=-1.797693135e+308)
get_number_12 = GetNumber(hour, AtLeast=1, AtMost=2147483647, Maximum=1.797693135e+308, Minimum=-1.797693135e+308)
gencumulativeskymtx = Ladybug_GenCumulativeSkyMtx(epwFile=panel_5, skyDensity=Slider(0, range=0..100), useOldRes=True, runIt=Toggle(True))  # -> out, cumulativeSkyMtx; plug-in component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
analysisperiod = Ladybug_AnalysisPeriod(
    fromMonth=get_number_9,
    fromDay=get_number_7,
    fromHour=get_number_8,
    toMonth=get_number_10,
    toDay=get_number_11,
    toHour=get_number_12)  # -> out, analysisPeriod; plug-in component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
selectskymtx = Ladybug_selectSkyMtx(
    cumulativeSkyMtx=gencumulativeskymtx.cumulativeSkyMtx,
    analysisPeriod=analysisperiod.analysisPeriod,
    removeDiffuse=False,
    removeDirect=False)  # -> out, selectedSkyMtx; plug-in component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
radiationanalysis = Ladybug_RadiationAnalysis(
    north=target_surface,
    context=flatten(surroundings),
    gridSize=Slider(13, range=0..100),
    disFromBase=Slider(0.1, range=0..0.1),
    selectedSkyMtx=flatten(selectskymtx.selectedSkyMtx),
    runIt=Toggle(True))  # -> out, contextMesh, analysisMesh, testPts, testVec, port, radiationResult, radiationMesh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; plug-in component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
panel_6 = Panel(radiationanalysis.radiationResult)

# ---- group: Output
mesh = Mesh(radiationanalysis.radiationLegend)
mesh_2 = Mesh(radiationanalysis.radiationMesh)

# ----
panel_7 = Panel("http://climate.onebuilding.org/WMO_Region_4_North_and_Central_America/USA_United_States_of_America/IL_Illinois/USA_IL_Chicago.Midway.Intl.AP.725340_TMY3.zip")
genhbzonetestpts = Honeybee_GenerateZoneTestPoints(HBZone=brep_5, gridSize=Slider(0.4, range=0.1..1), distBaseSrf=Slider(0.099, range=0..1), moveTestMesh=Toggle(True))  # -> readMe, simplify(testPoints), simplify(ptsVectors), simplify(facesArea), simplify(mesh); plug-in component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
toggle = BooleanToggle(True)

epw_stat_2 = Ladybug_OpenEPWAndSTATWeatherFiles(weatherFileURL=panel_7)  # -> epwFile, statFile; plug-in component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

annualdaylightsimulation = Honeybee_AnnualDaylightSimulation(
    epwWeatherFile=epw_stat_2.epwFile,
    testPoints=genhbzonetestpts.testPoints,
    ptsVectors=genhbzonetestpts.ptsVectors,
    testMesh=genhbzonetestpts.mesh)  # -> analysisRecipe; plug-in component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

occupancygenerator = Honeybee_DaysimOccupancyGenerator(weekendDays=[1, 2], writeTheOcc=Toggle(True))  # -> occupancyFile; plug-in component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
rundaylightanalysis = Honeybee_RunDaylightSimulation(
    HBObjects=flatten([brep_5, createhbsrfs.HBSurface]),
    analysisRecipe=annualdaylightsimulation,
    writeRad=toggle,
    runRad=toggle,
    numOfCPUs="16",
    workingDir=panel,
    radFileName="HB_Basic",
    overwriteResults=True)  # -> out, analysisType, resultsUnit, results, testPts, resultFiles, radGeoFile, studyFolder, done; plug-in component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
readannualresultsi = Honeybee_ReadAnnualResultI(
    illFilesAddress=rundaylightanalysis.resultFiles,
    testPoints=simplify(rundaylightanalysis.testPts),
    occupancyFiles=occupancygenerator,
    DLAIllumThresholds=300,
    SHDGroupII_Sensors=genhbzonetestpts.mesh,
    runIt=Toggle(True))  # -> DLA, UDLI_Less_100, UDLI_100_2000, UDLI_More_2000, CDA, sDA, annualProfiles, htmReport; plug-in component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
recolormesh = Ladybug_RecolorMesh(
    analysisResult=readannualresultsi.DLA,
    inputMesh=readannualresultsi.UDLI_Less_100,
    heightDomain=dom,
    legendPar=legendpar,
    legendTitle="Percentage",
    bakeIt=Toggle(True),
    layerName="HB Room Analysis")  # -> out, newMesh, newLegend, legendBasePt, meshColors, legendColors; plug-in component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
panel_8 = Panel(readannualresultsi.sDA)

# ---- group: Output
number = Number(panel_8)
mesh_3 = Mesh(recolormesh.newMesh)
mesh_4 = Mesh(recolormesh.newLegend)
