# Grasshopper definition Sketch_To_Geometry.gh (Grasshopper 1.0.7)

# ---- group: USER PARAMETERS
triangle_radius = Slider(8.377, range=0..20)
length = Slider(13.807, range=0..20)
width = Slider(15.685, range=0..20)
pentagon_radius = Slider(12.71, range=0..20)
circle_radius = Slider(11.568, range=0..20)

floor_to_floor_height = Slider(4, range=2.8..4)
number_of_floors = Slider(9, range=0..20)

# ----
# Range - 0 to 20
circle_radius_2 = GetNumber(circle_radius, AtLeast=1, AtMost=2147483647, Maximum=1.797693135e+308, Minimum=-1.797693135e+308)
width_2 = GetNumber(width, AtLeast=1, AtMost=2147483647, Maximum=1.797693135e+308, Minimum=-1.797693135e+308)
# Range - 0 to 20
pentagon_radius_2 = GetNumber(pentagon_radius, AtLeast=1, AtMost=2147483647, Maximum=1.797693135e+308, Minimum=-1.797693135e+308)
# Range - 0 to 20
length_2 = GetNumber(length, AtLeast=1, AtMost=2147483647, Maximum=1.797693135e+308, Minimum=-1.797693135e+308)
fllor_to_floor_height = GetNumber(floor_to_floor_height, AtLeast=1, AtMost=2147483647, Maximum=1.797693135e+308, Minimum=-1.797693135e+308)
no_of_floors = GetNumber(number_of_floors, AtLeast=1, AtMost=2147483647, Maximum=1.797693135e+308, Minimum=-1.797693135e+308)
websocket_client_start = WebsocketClientStart(Address="wss://hmc-hackathon-server.glitch.me/", InitalMessage="Hello World", Reset=Toggle(False))
websocket_client_receiver = WebsocketClientReceiver(WebsocketObjects=websocket_client_start, AutoUpdate=True)  # -> Message, Status
polygon = Polygon(Plane=PlaneXY(0, 0, 0), Radius=triangle_radius, Segments=3, FilletRadius=0)  # -> Polygon, Length
rectangle = Rectangle(Plane=PlaneXY(0, 0, 0), XSize=length_2, YSize=width_2, Radius=0)  # -> Rectangle, Length
polygon_2 = Polygon(Plane=PlaneXY(0, 0, 0), Radius=pentagon_radius_2, Segments=5, FilletRadius=0)  # -> Polygon, Length
# Range - 0 to 20
circle = Circle(Plane=PlaneXY(0, 0, 0), Radius=circle_radius_2)
panel = Panel(websocket_client_receiver.Message)
# Range - 0 to 20
get_string = GetString(panel, AtLeast=1, AtMost=2147483647)
# Range - 2.8 to 4m
c_script = CSharpScript(
    Triangle=polygon.Polygon,
    Rectangle=rectangle.Rectangle,
    Pentagon=polygon_2.Polygon,
    Circle=circle,
    Classification=get_string)  # -> out, A; inputs Triangle: Curve, Rectangle: Curve, Pentagon: Curve, Circle: Curve, Classification: String
# ---------- c_script: C# ----------
    if(Classification == "TRIANGLE"){
      A = Triangle;}
    if(Classification == "SQUARE AND RECTANGLE"){
      A = Rectangle;}
    if(Classification == "PENTAGON"){
      A = Pentagon;}
    if(Classification == "CIRCLE"){
      A = Circle;}
# ---------- end c_script ----------
boundary_surfaces = BoundarySurfaces(Edges=c_script.A)
unit_z = UnitZ(Factor=fllor_to_floor_height)
series = Series(Start=0, Step=fllor_to_floor_height, Count=no_of_floors)
extrude = Extrude(Base=boundary_surfaces, Direction=unit_z)
unit_z_2 = UnitZ(Factor=series)
panel_2 = Panel("""false
true
false
false
false
false
false
false""")
move = Move(Geometry=extrude, Motion=unit_z_2)  # -> Geometry, Transform
number_slider = Slider(0.5, range=0..1)

# ---- group: USER PARAMETERS
opening_ht_from_ceiling = Slider(0.665, range=0..1)
opening_ht_from_floor = Slider(0.342, range=0..1)
open_width_from_corner_1 = Slider(0.766, range=0..1)
# All Range - 0 to  1 as the component is reparametrized
open_width_from_corner_2 = Slider(0.2, range=0..1)

# ----
deconstruct_brep = DeconstructBrep(Brep=move.Geometry)  # -> Faces, Edges, Vertices
deconstruct_brep_2 = DeconstructBrep(Brep=move.Geometry)  # -> Faces, Edges, Vertices
cull_pattern = CullPattern(List=deconstruct_brep.Faces, CullPattern=panel_2)
curve = Curve(deconstruct_brep_2.Edges)
divide_domain² = DivideDomain²(Domain=cull_pattern, UCount=number_slider, VCount=number_slider)
construct_domain² = ConstructDomain²(UMin=opening_ht_from_ceiling, UMax=opening_ht_from_floor, VMin=open_width_from_corner_1, VMax=open_width_from_corner_2)
boundary_surfaces_2 = BoundarySurfaces(Edges=deconstruct_brep_2.Edges)
isotrim = Isotrim(Surface=reparameterize(cull_pattern), Domain=divide_domain²)
isotrim_2 = Isotrim(Surface=reparameterize(isotrim), Domain=construct_domain²)
area = Area(Geometry=isotrim_2)  # -> Area, Centroid
evaluate_surface = EvaluateSurface(Surface=isotrim_2, Point=area.Centroid)  # -> Point, Normal, UDirection, VDirection, Frame
extrude_2 = Extrude(Base=isotrim_2, Direction=evaluate_surface.Normal)
multiplication = Multiplication(A=evaluate_surface.Normal, B=Slider(-1, range=-10..10))
move_2 = Move(Geometry=extrude_2, Motion=multiplication)  # -> simplify(flatten(Geometry)), Transform
brep = Brep(move_2.Geometry)
brep_2 = Brep(flatten(move.Geometry))
trim_solid = TrimSolid(Shape=brep_2, Cutters=brep)

# ---- group: RH_OUT: Opening Brep
openings_brep = Brep(isotrim_2)

# ---- group: RH_OUT: Whole Building Brep
whole_building_brep = Brep(trim_solid)

# ---- group: RH_OUT: Base
brep_3 = Brep(boundary_surfaces_2)
