# Grasshopper definition hops-sketch-to-geometry-n-ladybug-analysis.gh (Grasshopper 1.0.7)
# plug-ins: Hops, jSwan

websocket_client_start = WebsocketClientStart(Address="wss://hmc-hackathon-server.glitch.me/", InitalMessage="Hello World", Reset=False)
websocket_client_start_2 = WebsocketClientStart(Address="wss://hmc-hackathon-server.glitch.me/", InitalMessage="Hello World", Reset=Toggle(False))
websocket_client_receiver = WebsocketClientReceiver(WebsocketObjects=websocket_client_start, AutoUpdate=True)  # -> Message, Status
websocket_client_receiver_2 = WebsocketClientReceiver(WebsocketObjects=websocket_client_start_2, AutoUpdate=True)  # -> Message, Status
deserialize_keys_and_values = DeserializeKeysAndValues(JSON=websocket_client_receiver_2.Message)  # -> Key, Value
panel = Panel(deserialize_keys_and_values.Key)
panel_2 = Panel(websocket_client_receiver_2.Message)
panel_3 = Panel(deserialize_keys_and_values.Value)
list_item = ListItem(List=panel_3, Index=0, Wrap=True)  # -> Item, Item1, Item2, Item3, Item4, Item5, Item6, Item7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
division = Division(A=list_item.Item9, B=Slider(10, range=0..10))
division_2 = Division(A=list_item.Item6, B=Slider(10, range=0..10))
division_3 = Division(A=list_item.Item10, B=Slider(10, range=0..10))
division_4 = Division(A=list_item.Item8, B=Slider(10, range=0..10))
division_5 = Division(A=list_item.Item11, B=Slider(10, range=0..10))
hops = Hops(
    CurveFromVoice=list_item.Item,
    RecLength=list_item.Item2,
    RecWidth=list_item.Item3,
    PentagonRadius=list_item.Item4,
    CircleRadius=list_item.Item5,
    FllorToFloorHeight=division_2,
    NoOfFloors=list_item.Item7,
    WindowOpeningHtFromCeiling=division_4,
    WindowOpeningHtFromFloor=division,
    WindowOpeningWFromC1=division_3,
    WindowOpeningWFromC2=division_5,
    TriangleRadius=list_item.Item1,
    CacheResultsInMemory=True,
    CacheSolveResults=True,
    RemoteDefinitionLocation="C:\Users\richa\Downloads\Sketch_To_Geometry.gh",
    RemoteSolveVersion=(0, 1, 0),
    ShowInput_Enabled=False,
    ShowInput_Path=False,
    SynchronousSolve=True)  # -> OpeningBrep, WholeBuildingBrep, Base
radiation_analysis = Hops(
    WeatherFileURL="http://climate.onebuilding.org/WMO_Region_4_North_and_Central_America/USA_United_States_of_America/IL_Illinois/USA_IL_Chicago.Midway.Intl.AP.725340_TMY3.zip",
    FromMonth=4,
    FromDay=1,
    FromHour=12,
    ToMonth=6,
    ToDay=1,
    ToHour=17,
    CacheResultsInMemory=True,
    CacheSolveResults=True,
    RemoteDefinitionLocation="C:\Users\richa\Desktop\HMC\Env Analysis.gh",
    RemoteSolveVersion=(0, 1, 0),
    ShowInput_Enabled=False,
    ShowInput_Path=False,
    SynchronousSolve=True)  # -> RadiationMesh, RadiationLegend; disabled
daylight = Hops(
    WeatherFileURL="http://climate.onebuilding.org/WMO_Region_4_North_and_Central_America/USA_United_States_of_America/IL_Illinois/USA_IL_Chicago.Midway.Intl.AP.725340_TMY3.zip",
    CacheResultsInMemory=True,
    CacheSolveResults=True,
    RemoteDefinitionLocation="C:\Users\richa\Downloads\LB_For Hops.gh",
    RemoteSolveVersion=(0, 1, 0),
    ShowInput_Enabled=False,
    ShowInput_Path=False,
    SynchronousSolve=True)  # -> Legend, SDA, AnalysedMesh; disabled
mesh = Mesh(daylight.AnalysedMesh)
